# Grasshopper definition UI exercises.gh (Grasshopper 0.9.76)
# plug-ins: Human UI

angle_z = Slider(25.9, range=-90..90)
offset_1 = Slider(152, range=30..400)
offset_2 = Slider(325, range=100..400)
series = Series(Start="2", Step="1", Count="8")
int = Integer(series)
pulldown = CreatePulldownMenu(ListItems=int, SelectedIndex=1)
slider = CreateSlider(Slider=angle_z, SnapValue=0, ShowBounds=False, ShowTicks=False, ShowTooltip=False, ShowValLabel=True)
slider_2 = CreateSlider(Slider=offset_1, SnapValue=0, ShowBounds=False, ShowTicks=False, ShowTooltip=False, ShowValLabel=True)
slider_3 = CreateSlider(Slider=offset_2, SnapValue=0, ShowBounds=False, ShowTicks=False, ShowTooltip=False, ShowValLabel=True)
textbox = CreateTextBox(Label="Thickness", DefaultText="50", UpdateButton=True)
number_slider = Slider(43, range=0..100)
stack = CreateStack(UIElements=[slider_2, slider_3], Horizontal=True)
pi = Pi(Factor="2")
values = ValueListener(Elements=pulldown, SomeProperty=True)  # -> Values, Indices
slide_you_after = Slider(81, range=50..90)
slide_me = Slider(57, range=50..90)
range = Range(Domain=pi, Steps=values.Values)
values_2 = ValueListener(Elements=textbox, SomeProperty=True)  # -> Values, Indices
values_3 = ValueListener(Elements=slider, SomeProperty=True)  # -> Values, Indices
adjustpos = AdjustElementPositioning(ElementsToAdjust=stack, AbsolutePositioning=False, HorizontalAlignment=1)
launchxpwin = LaunchTransparentWindow(
    Show=Toggle(False),
    Name="My very first UI",
    Width=Slider(437, range=0..1000),
    Height=Slider(680, range=0..1000),
    ChildStatus=0)
shift = ShiftList(List=range, Shift=1, Wrap=invert(True))
rad = Radians(Degrees=values_3.Values)
merge = Merge(Data1=flatten(pulldown), Data2=flatten(slider), Data3=stack, Data4=textbox)  # -> flatten(Result)
values_4 = ValueListener(Elements=slider_2, SomeProperty=True)  # -> Values, Indices
values_5 = ValueListener(Elements=slider_3, SomeProperty=True)  # -> Values, Indices
slider_4 = CreateSlider(Slider=slide_you_after, ShowBounds=True, ShowTicks=True, ShowTooltip=False, ShowValLabel=False)
pt = ConstructPoint(XCoordinate=Slider(0, range=0..1000), YCoordinate=Slider(0, range=0..1000), ZCoordinate=0)
slider_5 = CreateSlider(Slider=slide_me, ShowBounds=True, ShowTicks=True, ShowTooltip=False, ShowValLabel=False)
label = CreateLabel(LabelText="Slide the slider sliding", LabelSize=24, Justification=1)
pt_2 = PointPolar(BasePlane=PlaneXY(0, 0, 0), XYAngle=shift, ZAngle=rad, Offset=graft([values_4.Values, values_5.Values]))
winprops = SetWindowProperties(
    Window=launchxpwin,
    StartingLocation=pt,
    Theme=1,
    ShowTitleBar=Toggle(True),
    BackgroundColor=ColourSwatch(SwatchColor=RGB(0, 0, 0)))
adjustpos_2 = AdjustElementPositioning(ElementsToAdjust=slider_5, AbsolutePositioning=False, Width=Slider(687, range=0..1000), HorizontalAlignment=2)
flip = FlipMatrix(Data=pt_2)
adjustpos_3 = AdjustElementPositioning(ElementsToAdjust=slider_4, AbsolutePositioning=Toggle(False), Width=Slider(717, range=0..1000), HorizontalAlignment=2)
values_6 = ValueListener(Elements=slider_4, SomeProperty=True)  # -> Values, Indices
values_7 = ValueListener(Elements=slider_5, SomeProperty=True)  # -> Values, Indices
addition = Addition(A=values_7.Values, B=values_6.Values)
pline = PolyLine(Vertices=flip, Closed=False)
pframe = PerpFrame(Curve=reparameterize(pline), Parameter=0.5)
Z = UnitZ(Factor=1)
label_2 = CreateLabel(LabelText="Slider Addition result", LabelSize=18, Justification=1)
setlabel = SetLabelContents(LabelToModify=label_2, NewLabelContents=addition)
align = AlignPlane(Plane=pframe, Direction=Z)  # -> Plane, Angle
merge_2 = Merge(Data1=label, Data2=slider_5, Data3=slider_4, Data4=label_2)
deplane = DeconstructPlane(Plane=align.Plane)  # -> Origin, XAxis, YAxis, ZAxis
amp = Amplitude(Vector=deplane.XAxis, Amplitude=values_2.Values)
addelems = AddElements(Window=launchxpwin, Elements=flatten(merge_2))  # -> AddedElements, ElementNames
move = Move(Geometry=pline, Motion=expr("-x", amp))  # -> Geometry, Transform
extr = Extrude(Base=move.Geometry, Direction=expr("x*2", amp))
debrep = DeconstructBrep(Brep=extr)  # -> Faces, Edges, Vertices
number_slider_2 = Slider(820, range=0..1000)
item = ListItem(List=debrep.Vertices, Index=0, Wrap=True)  # -> Item, Item1
getscreen = GetScreenDimensions()  # -> Width, Height
pline_2 = PolyLine(Vertices=flatten(item.Item1), Closed=invert(False))
pline_3 = PolyLine(Vertices=flatten(item.Item), Closed=invert(False))
launchxpwin_2 = LaunchTransparentWindow(
    Show=Toggle(False),
    Name="COMPONENT VISUALIZATION",
    Width=Slider(600, range=0..1000),
    Height=getscreen.Height,
    ChildStatus=0)
number_slider_3 = Slider(527, range=0..1000)
number_slider_4 = Slider(300, range=0..1000)
loft = Loft(
    Curves=[pline_3, pline_2],
    Options={Adjust=False, Closed=False, LoftEnds=0, LoftSimp=0, LoftType=0, Rebuild=10, Refit=0.01})
pt_3 = ConstructPoint(XCoordinate=Slider(0, range=0..1000), YCoordinate=Slider(0, range=0..1000), ZCoordinate=0)
swatch = ColourSwatch(SwatchColor=RGB(255, 255, 255))
mesh = MeshBrep(
    Brep=flatten([extr, loft]),
    Settings={GridMaxCount=0, GridMinCount=16, JaggedSeams=False, MaxEdgeLength=0, MinEdgeLength=0.0001, MinTolerance=0, Refine=True, RefineAngle=0, RelativeTolerance=0.65, SimplePlanes=True, Tolerance=0})
box = CenterBox(Base=PlaneXY(0, 0, 0), X=number_slider_4, Y=number_slider_4, Z=number_slider_4)
winprops_2 = SetWindowProperties(
    Window=launchxpwin_2,
    StartingLocation=pt_3,
    Theme=1,
    ShowTitleBar=Toggle(True),
    BackgroundColor=ColourSwatch(SwatchColor=RGB(0, 0, 0)))
_3dview = Create3DView(MeshToDisplay=box, MeshColors=swatch, ViewWidth=number_slider_3, ViewHeight=number_slider_3)
label_3 = CreateLabel(LabelText="COSTUMIZE YOUR JOINT SYSTEM", LabelSize=24, Justification=1)
adjustpos_4 = AdjustElementPositioning(ElementsToAdjust=_3dview, AbsolutePositioning=False, HorizontalAlignment=1, VerticalAlignment=1)
set3dview = Set3DView(_3DView=_3dview, MeshToDisplay=mesh, MeshColors=swatch)
merge_3 = Merge(Data1=_3dview, Data2=label_3, Data3=merge)
addelems_2 = AddElements(Window=launchxpwin_2, Elements=flatten(merge_3))  # -> AddedElements, ElementNames
