# Grasshopper definition kangaroo exercises.gh (Grasshopper 0.9.76)
# plug-ins: Weaverbird, Kangaroo2 Components

number_slider = Slider(100, range=0..100)  # disabled
number_slider_2 = Slider(4, range=0..10)
B = Base({Plane=PlaneXY(0, 0, 0), X=Domain(-10, 10), Y=Domain(-10, 10), Z=Domain(-10, 10)})
number_slider_3 = Slider(1, range=0..1)  # disabled
rectangle = Rectangle(Plane=PlaneXY(0, 0, 0), XSize=number_slider, YSize=number_slider, Radius=0)  # -> Rectangle, Length; disabled
mbox = MeshBox(Base=B, XCount=number_slider_2, YCount=number_slider_2, ZCount=number_slider_2)
number_slider_4 = Slider(37, range=0..100)  # disabled
crv = Curve([<curve referenced from the Rhino model> x4])  # disabled
number_slider_5 = Slider(60, range=0..100)
crv_2 = Curve(<curve referenced from the Rhino model>)  # disabled
demesh = DeconstructMesh(Mesh=mbox)  # -> Vertices, Faces, Colours, Normals
number_slider_6 = Slider(5, range=0..10)  # disabled
number_slider_7 = Slider(4, range=0..10)
divide = DivideCurve(Curve=crv, Count=10, Kinks=False)  # -> Points, Tangents, Parameters; disabled
mplane = MeshPlane(Boundary=rectangle.Rectangle, WidthCount=10, HeightCount=10)  # -> Mesh, Area; disabled
number_slider_8 = Slider(100, range=0..100)  # disabled
divide_2 = DivideCurve(Curve=crv_2, Count=10, Kinks=False)  # -> Points, Tangents, Parameters; disabled
item = ListItem(List=demesh.Vertices, Index=0, Wrap=True)
mbox_2 = MeshBox(
    Base={Plane=PlaneXY(0, 0, 0), X=Domain(-10, 10), Y=Domain(-10, 10), Z=Domain(-10, 10)},
    XCount=number_slider_3,
    YCount=number_slider_3,
    ZCount=number_slider_3)  # disabled
rectangle_2 = Rectangle(Plane=PlaneXY(0, 0, 0), XSize=number_slider_4, YSize=number_slider_4, Radius=0)  # -> Rectangle, Length; disabled
pline = PolyLine(Vertices=divide.Points, Closed=False)  # disabled
rectangle_3 = Rectangle(Plane=PlaneXY(0, 0, 0), XSize=number_slider_5, YSize=number_slider_5, Radius=0)  # -> Rectangle, Length
tri = Triangulate(Mesh=mplane.Mesh)  # -> Mesh, Count; disabled
orient = Orient(Geometry=mbox, Source=item, Target=PlaneXY(0, 0, 0))  # -> Geometry, Transform
pline_2 = PolyLine(Vertices=divide_2.Points, Closed=False)  # disabled
explode = Explode(Curve=pline, Recursive=True)  # -> Segments, Vertices; disabled
pop2d = Populate2D(Region=rectangle.Rectangle, Count=number_slider_8, Seed=1)  # disabled
arrrec = RectangularArray(Geometry=mbox_2, Cell=rectangle_2.Rectangle, XCount=number_slider_6, YCount=number_slider_6)  # -> Geometry, Transform; disabled
arrrec_2 = RectangularArray(Geometry=orient.Geometry, Cell=rectangle_3.Rectangle, XCount=number_slider_7, YCount=number_slider_7)  # -> Geometry, Transform
explode_2 = Explode(Curve=pline_2, Recursive=True)  # -> Segments, Vertices; disabled
mesh = Mesh(tri.Mesh)  # disabled
wbvertices = WeaverbirdsVerticesComponent(MeshClosedPolylinesGroup=arrrec_2.Geometry, Weld=True)
debox = DeconstructBox(Box=B)  # -> Plane, X, Y, Z
number_slider_9 = Slider(4.3, range=0..10)  # disabled
crv_3 = Curve(explode_2.Segments)  # disabled
pt = Point(explode_2.Vertices)  # disabled
disc = Discontinuity(Curve=crv, Level=1)  # -> Points, Parameters; disabled
bbox = BoundingBox(Content=arrrec_2.Geometry, Plane=PlaneXY(0, 0, 0))  # -> Box, Box_2
number_slider_10 = Slider(0, range=0..1)  # disabled
dedomain = DeconstructDomain(Domain=debox.X)  # -> Start, End
panel = Panel("1")  # disabled
wbvertices_2 = WeaverbirdsVerticesComponent(MeshClosedPolylinesGroup=arrrec.Geometry, Weld=True)  # disabled
number_slider_11 = Slider(0.53, range=0..2)  # disabled
number_slider_12 = Slider(2, range=0..2)  # disabled
crv_4 = Curve(explode.Segments)  # disabled
pt_2 = Point(explode.Vertices)  # disabled
crv_5 = Curve(explode_2.Segments)  # disabled
shift = ShiftList(List=crv_3, Shift=panel, Wrap=invert(True))  # disabled
debrep = DeconstructBrep(Brep=bbox.Box)  # -> Faces, Edges, Vertices
pt_3 = Point(debrep.Vertices)
pull = PullPoint(Point=wbvertices, Geometry=pt_3, ClosestOnly=True)  # -> ClosestPoint, Distance
equals = Equality(FirstNumber=pull.Distance, SecondNumber=0)  # -> Equality, Inequality
expression = Expression(x=dedomain.Start, y=dedomain.End, Expression="(y-x)/4")
number_slider_13 = Slider(1000, range=0..1000)  # disabled
medges = MeshEdges(Mesh=mesh)  # -> NakedEdges, InteriorEdges, NonManifoldEdges; disabled
len = Length(Curve=crv_5)  # disabled
number_slider_14 = Slider(0, range=0..1)  # disabled
panel_2 = Panel("1")  # disabled
crv_6 = Curve(crv_4)  # disabled
rigidbody = RigidBody(Part=graft(arrrec.Geometry), Points=wbvertices_2, Strength=1)  # -> flatten(RigidBody); disabled
item_2 = ListItem(List=explode_2.Vertices, Index=0, Wrap=True)  # disabled
avr = Average(Input=pt_3)
ms = MagnetSnap(Points=flatten(wbvertices_2), Range=number_slider_9, Strength=10)  # disabled
cull = CullPattern(List=wbvertices, CullPattern=equals.Inequality)  # -> flatten(List)
faceb = FaceBoundaries(Mesh=mesh)  # disabled
grab = Grab(On=True, Strength=1, Range=3)  # -> Grab, Anchors; disabled
number_slider_15 = Slider(100, range=0..100)  # disabled
spc = SolidPointCollide(Interior=False, Unidirectional=False, Strength=1)  # disabled
number_slider_16 = Slider(10, range=0..100)  # disabled
number_slider_17 = Slider(0, range=0..100)  # disabled
number_slider_18 = Slider(75, range=0..100)  # disabled
number_slider_19 = Slider(10, range=0..10)  # disabled
number_slider_20 = Slider(10, range=0..10)  # disabled
number_slider_21 = Slider(10, range=0..10)  # disabled
number_slider_22 = Slider(5.7, range=0..10)  # disabled
number_slider_23 = Slider(10, range=0..10)  # disabled
number_slider_24 = Slider(1000, range=0..1000)  # disabled
Z = UnitZ(Factor="-20")
shift_2 = ShiftList(List=crv_6, Shift=panel_2, Wrap=invert(True))  # disabled
panel_3 = Panel("0")  # disabled
short = ShortestList(ListA=crv_3, ListB=shift, TrimMode=2)  # -> ListA, ListB; disabled
pi = Pi(Factor=number_slider_10)  # disabled
multiplication = Multiplication(A=len, B=number_slider_11)  # disabled
multiplication_2 = Multiplication(A=len, B=number_slider_12)  # disabled
rigidbody_2 = RigidBody(Part=graft(arrrec_2.Geometry), Points=debrep.Vertices, Strength=1)  # -> flatten(RigidBody)
panel_4 = Panel("-9.8")  # disabled
ms_2 = MagnetSnap(Points=flatten(debrep.Vertices), Range=Slider(5, range=0..10), Strength=100)
sc = SphereCollide(Points=flatten(avr), Radius=expression, Strength=50)
floor = Floor(Strength=10)
wbvertices_3 = WeaverbirdsVerticesComponent(MeshClosedPolylinesGroup=mesh, Weld=True)  # disabled
grab_2 = Grab(On=True, Strength=1, Range=3)  # -> Grab, Anchors
spc_2 = SolidPointCollide(Points=cull, Solid=arrrec_2.Geometry, Interior=False, Unidirectional=False, Strength=100)
explode_3 = Explode(Curve=faceb, Recursive=True)  # -> Segments, Vertices; disabled
load = Load(Point=wbvertices, ForceVector=Z)
short_2 = ShortestList(ListA=crv_6, ListB=shift_2, TrimMode=2)  # -> ListA, ListB; disabled
pi_2 = Pi(Factor=number_slider_14)  # disabled
Z_2 = UnitZ(Factor=panel_4)  # disabled
clamplength = ClampLength(Line=crv_5, LowerLimit=multiplication, UpperLimit=multiplication_2, Strength=1)  # disabled
angle = Angle(LineA=short.ListA, LineB=short.ListB, RestAngle=pi, Strength=number_slider_13)  # disabled
Z_3 = UnitZ(Factor=panel_3)  # disabled
anchor = Anchor(Point=item_2, Strength=1000)  # disabled
grab_3 = Grab(On=True, Strength=1, Range=10)  # -> Grab, Anchors; disabled
onplane = OnPlane(Points=pt, Plane=PlaneXY(0, 0, 0), Strength=1)  # disabled
length_line = LengthLine(Line=crv_5, Strength=10)  # disabled
show = Show(G=crv_5)  # disabled
grab_4 = Grab(On=True, Strength=number_slider_19, Range=3)  # -> Grab, Anchors; disabled
smooth = Smooth(M=mesh, Strength=number_slider_20)  # disabled
length_line_2 = LengthLine(Line=[medges.NakedEdges, medges.InteriorEdges], Strength=10)  # disabled
ms_3 = MagnetSnap(Points=flatten(disc.Points), Range=number_slider_21, Strength=number_slider_16)  # disabled
plasticanchor = PlasticAnchor(Point=wbvertices_3, Limit=1, Strength=1)  # disabled
onmesh = OnMesh(Points=pop2d, Mesh=mesh, Strength=number_slider_18)  # disabled
angle_2 = Angle(LineA=short_2.ListA, LineB=short_2.ListB, RestAngle=pi_2, Strength=number_slider_24)  # disabled
equallength = EqualLength(Line=explode_3.Segments, Strength=number_slider_17)  # disabled
sc_2 = SphereCollide(Points=pop2d, Radius=number_slider_22, Strength=number_slider_15)  # disabled
grab_5 = Grab(On=True, Strength=number_slider_23, Range=10)  # -> Grab, Anchors; disabled
floor_2 = Floor(Strength=100)  # disabled
length_line_3 = LengthLine(Line=crv_4, Strength=10)  # disabled
load_2 = Load(Point=pop2d, ForceVector=Z_3)  # disabled
show_2 = Show(G=[pop2d, mesh])  # disabled
button = Button()  # disabled
toggle = BooleanToggle(True)  # disabled
load_3 = Load(Point=pt_2, ForceVector=Z_2)  # disabled
show_3 = Show(G=crv_4)  # disabled
merge = Merge(Data1=grab.Grab, Data3=rigidbody, Data4=ms)  # disabled
merge_2 = Merge(Data1=grab_2.Grab, Data3=rigidbody_2, Data4=ms_2, Data5=spc_2, Data6=sc, Data7=load, Data8=floor)
button_2 = Button()  # disabled
merge_3 = Merge(Data1=anchor, Data2=grab_3.Grab, Data3=show, Data4=length_line, Data5=angle, Data6=onplane)  # disabled
solver = Solver(GoalObjects=merge, Reset=button, Threshold=1e-15, Tolerance=0.01, On=toggle)  # -> I, V, O; disabled
button_3 = Button()  # disabled
merge_4 = Merge(
    Data1=grab_4.Grab,
    Data2=show_2,
    Data3=length_line_2,
    Data5=smooth,
    Data6=plasticanchor,
    Data7=equallength,
    Data8=onmesh,
    Data9=sc_2,
    Data10=load_2)  # disabled
solver_2 = Solver(GoalObjects=merge_2, Reset=Button(), Threshold=1e-15, Tolerance=0.01, On=Toggle(True))  # -> I, V, O
toggle_2 = BooleanToggle(True)  # disabled
button_4 = Button()  # disabled
merge_5 = Merge(Data1=grab_5.Grab, Data2=show_3, Data3=length_line_3, Data4=angle_2, Data5=load_3, Data6=floor_2, Data7=ms_3)  # disabled
solver_bouncy = SolverBouncy(GoalObjects=merge_3, Reset=button_2, Threshold=1e-15, Tolerance=0.01, Damping=0.99, Iterations=10, On=True)  # -> I, V, O; disabled
data = Data(solver.O)  # disabled
solver_bouncy_2 = SolverBouncy(GoalObjects=merge_4, Reset=button_4, Threshold=1e-15, Tolerance=0.01, Damping=0.99, Iterations=10, On=toggle_2)  # -> I, V, O; disabled
data_2 = Data(solver_2.O)
solver_bouncy_3 = SolverBouncy(GoalObjects=merge_5, Reset=button_3, Threshold=1e-15, Tolerance=0.01, Damping=0.99, Iterations=10, On=True)  # -> I, V, O; disabled
data_3 = Data(solver_bouncy.O)  # disabled
clean = CleanTree(RemoveNulls=True, RemoveInvalid=True, RemoveEmpty=False, Tree=data_3)  # disabled
data_4 = Data(solver_bouncy_2.O)  # disabled
data_5 = Data(solver_bouncy_3.O)  # disabled
clean_2 = CleanTree(RemoveNulls=True, RemoveInvalid=True, RemoveEmpty=False, Tree=data_4)  # disabled
mesh_2 = Mesh(clean_2)  # disabled
pt_4 = Point(clean_2)  # disabled
clean_3 = CleanTree(RemoveNulls=True, RemoveInvalid=True, RemoveEmpty=False, Tree=mesh_2)  # disabled
clean_4 = CleanTree(RemoveNulls=True, RemoveInvalid=True, RemoveEmpty=False, Tree=pt_4)  # disabled
meshcp = MeshClosestPoint(Point=clean_4, Mesh=clean_3)  # -> Point, Index, Parameter; disabled
meval = MeshEval(Mesh=clean_3, Parameter=meshcp.Parameter)  # -> Point, Normal, Colour; disabled
pl = PlaneNormal(Origin=meval.Point, ZAxis=meval.Normal)  # disabled
cir = Circle(Plane=pl, Radius=number_slider_22)  # disabled
